# Grasshopper definition Handset.gh (Grasshopper 1.0.8)
# plug-ins: ShapeDiverForGrasshopper

panel = Panel("https://github.com/Svi-ra/Archarm_test/blob/main/Textures/Handset/Handset_DefaultMaterial_Normal.jpg?raw=true")
panel_2 = Panel("https://github.com/Svi-ra/Archarm_test/blob/main/Textures/Handset/Handset_DefaultMaterial_BaseColor.jpg?raw=true")
panel_3 = Panel("https://github.com/Svi-ra/Archarm_test/blob/main/Textures/Handset/Handset_DefaultMaterial_MRT.jpg?raw=true")
panel_4 = Panel("D:\Archarm_test\Archarm_test\Models\Handset_1.fbx")
yz = YZPlane(Origin=Point(0, 0, 0))
gltf2material = GlTF20Material(
    BaseColorFactor=RGB(255, 255, 255),
    BaseColorTexture=panel_2,
    MetallicFactor=0,
    RoughnessFactor=1,
    MetallicRoughnessTexture=panel_3,
    NormalTexture=panel,
    EmissiveFactor=RGB(0, 0, 0),
    AlphaMode="OPAQUE",
    AlphaCutoff=0.5,
    DoubleSided=True)
geo = Geometry(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)
rotate = Rotate(Geometry=geo, Angle=1.570796327, Plane=yz)  # -> Geometry, Transform
X = UnitX(Factor=Slider(100, range=0..100))
move = Move(Geometry=rotate.Geometry, Motion=X)  # -> Geometry, Transform
gltfdisplay = GlTF20Display(Geometry=move.Geometry, Material=gltf2material)
